# Grasshopper definition RobotsJSON_PickandPlace.gh (Grasshopper 1.0.7)
# plug-ins: Robots

# ---- group: _old
brep = Brep([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])
brep_2 = Brep(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)

# ---- group: Table Outline
crv = Curve(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)

# ---- group: PickPt
init = Button()
pt = Point(Point(416, -243, 0))
unityobj = CSharpScript(Pt=pt, init=init)  # -> P, Q; inputs Pt: Point3d, init: Boolean
# ---------- unityobj: C# usings ----------
using Grasshopper.Kernel.Special;
using Grasshopper.GUI.Canvas;
# ---------- unityobj: C# ----------
    if(forceUpdate || init)
    {
      using(var args = new Rhino.Runtime.NamedParametersEventArgs())
      {
        Component.PingDocument -= OnPingDocument;
        Component.PingDocument += OnPingDocument;
        Component.ObjectChanged -= OnObjectChanged;
        Component.ObjectChanged += OnObjectChanged;
        Grasshopper.Instances.ActiveCanvas.DocumentChanged -= OnDocumentChanged;
        Grasshopper.Instances.ActiveCanvas.DocumentChanged += OnDocumentChanged;

        args.Set("id", Component.InstanceGuid.ToString());
        args.Set("pos", Pt * 0.001);
        Rhino.Runtime.HostUtils.ExecuteNamedCallback("FromGHTransform", args);

        Register(Component);
      }

      forceUpdate = false;
    }
  
    P = posValue;
    Q = quatValue;
# ---------- unityobj: C# additional code ----------
  Vector3d posValue;
  double[] quatValue = {};

  IGH_Component comp = null;

  bool forceUpdate = false;

  void Register(IGH_Component component)
  {
    Rhino.Runtime.HostUtils.RegisterNamedCallback("ToGH_Position_" + Component.InstanceGuid.ToString(), ToGrasshopper);
    Rhino.Runtime.HostUtils.RegisterNamedCallback("ToGH_Rotation_" + Component.InstanceGuid.ToString(), ToGrasshopper);

    comp = component;
  }

  void ToGrasshopper(object sender, Rhino.Runtime.NamedParametersEventArgs args)
  {
    Vector3d position;
    string quaternion;

    if (args.TryGetVector("position", out position))
    {
      posValue = new Vector3d(position.X, position.Z, position.Y);
    }
    if (args.TryGetString("rotationQuaternion", out quaternion))
    {
      quaternion = quaternion.Substring(1, quaternion.Length - 2);
      double[] doubleQuaternion = Array.ConvertAll(quaternion.Split(','), double.Parse);
      quatValue = doubleQuaternion;
    }

    comp.ExpireSolution(true);
  }

  public void OnPingDocument(object sender, GH_PingDocumentEventArgs e){
    if(e.Document == null){
      using(var args = new Rhino.Runtime.NamedParametersEventArgs()){
        args.Set("id", comp.InstanceGuid.ToString());
        args.Set("pos", posValue);
      }
    }
  }

  public void OnObjectChanged(object sender, GH_ObjectChangedEventArgs e){
    if(e.Type == GH_ObjectEventType.Enabled){
      if(comp.Locked){
        using(var args = new Rhino.Runtime.NamedParametersEventArgs()){
          forceUpdate = true;
          args.Set("id", comp.InstanceGuid.ToString());
          args.Set("pos", posValue);
        }
      }
    }

    comp.ExpireSolution(true);
  }

  public void OnDocumentChanged(object sender, GH_CanvasDocumentChangedEventArgs e){
    using(var args = new Rhino.Runtime.NamedParametersEventArgs()){
      args.Set("id", comp.InstanceGuid.ToString());
      args.Set("pos", posValue);

      forceUpdate = true;

      if(comp != null){
        comp.ExpireSolution(true);
      }
    }
  }
# ---------- end unityobj ----------
pt_2 = Point(Point(257.224878, -220.0456415, 0))
merge = Merge(Data1=unityobj.P, Data2=pt_2)

# ---- group: Initialize Basic Tool
# The tool is first defined as internalised Rhino Geometry (Brep)
tcpoffset_inwards_mm = Panel("10")
closed_grip_mm = Panel("40")

# ---- group: Initialize Basic Tool / Tool Dynamic Geo
tooldynamicgeo = Brep([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])

# ---- group: Initialize Basic Tool / Tool Static Geo
brep_3 = Brep([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])

# ----
unisli = CSharpScript()  # -> out, Value; inputs num: Double, init: Boolean
# ---------- unisli: C# ----------
    if(num != prevVal){
      prevVal = num;
      sliderVal = num;
    }

    var inputs = Component.Params.Input;
    var finput = inputs[0];
    if(finput.SourceCount > 0){
      var slicomp = finput.Sources[0];
      if(slicomp.GetType() == typeof(GH_NumberSlider)){
        var slider = (GH_NumberSlider) slicomp;
        double min = Convert.ToDouble(slider.Slider.Minimum);
        double max = Convert.ToDouble(slider.Slider.Maximum);
        double val = Convert.ToDouble(slider.Slider.Value);
        var name = slider.NickName;
        int decim = slider.Slider.DecimalPlaces;
        int type = (int) slider.Slider.Type;

        if(forceUpdate || min != prevMin || max != prevMax || name != prevName || decim != prevDecim || type != prevType || init){
          using(var args = new Rhino.Runtime.NamedParametersEventArgs()){
            Component.PingDocument -= OnPingDocument;
            Component.PingDocument += OnPingDocument;
            Component.ObjectChanged -= OnObjectChanged;
            Component.ObjectChanged += OnObjectChanged;
            Grasshopper.Instances.ActiveCanvas.DocumentChanged -= OnDocumentChanged;
            Grasshopper.Instances.ActiveCanvas.DocumentChanged += OnDocumentChanged;

            args.Set("id", Component.InstanceGuid.ToString());
            args.Set("name", name);
            args.Set("min", min);
            args.Set("max", max);
            args.Set("decimal", decim);
            args.Set("value", val);
            args.Set("type", type);
            Rhino.Runtime.HostUtils.ExecuteNamedCallback("FromGHClearUI", args);
            Rhino.Runtime.HostUtils.ExecuteNamedCallback("FromGHCreateSlider", args);

            Register(Component);
          }

          prevMin = min;
          prevMax = max;
          prevName = name;
          prevDecim = decim;
          prevType = type;
          forceUpdate = false;
        }
      }
    }


    Value = sliderVal;
# ---------- unisli: C# additional code ----------
  double sliderVal = 0.0;
  double prevVal = 0.0;
  IGH_Component comp = null;

  double prevMin = double.PositiveInfinity;
  double prevMax = double.PositiveInfinity;
  string prevName = "";
  int prevDecim = -1;
  int prevType = -1;
  bool forceUpdate = false;

  void Register(IGH_Component component)
  {
    Rhino.Runtime.HostUtils.RegisterNamedCallback("ToGH_Slider_" + Component.InstanceGuid.ToString(), ToGrasshopper);

    comp = component;
  }

  void ToGrasshopper(object sender, Rhino.Runtime.NamedParametersEventArgs args)
  {
    double val;
    if (args.TryGetDouble("sliderValue", out val)){
      sliderVal = val;

      if(Component.Params.Input[0].SourceCount > 0){
        var c = Component.Params.Input[0].Sources[0];
        if(c.GetType() == typeof(Grasshopper.Kernel.Special.GH_NumberSlider)){
          var slider = (Grasshopper.Kernel.Special.GH_NumberSlider) c;
          slider.SetSliderValue(Convert.ToDecimal(sliderVal));
        }
      }
    }

    comp.ExpireSolution(true);
  }

  public void OnPingDocument(object sender, GH_PingDocumentEventArgs e){
    if(e.Document == null){
      using(var args = new Rhino.Runtime.NamedParametersEventArgs()){
        args.Set("id", comp.InstanceGuid.ToString());
        Rhino.Runtime.HostUtils.ExecuteNamedCallback("FromGHClearUI", args);
      }
    }
  }

  public void OnObjectChanged(object sender, GH_ObjectChangedEventArgs e){
    if(e.Type == GH_ObjectEventType.Enabled){
      if(comp.Locked){
        using(var args = new Rhino.Runtime.NamedParametersEventArgs()){
          forceUpdate = true;
          args.Set("id", comp.InstanceGuid.ToString());
          Rhino.Runtime.HostUtils.ExecuteNamedCallback("FromGHClearUI", args);
        }
      }
    }

    comp.ExpireSolution(true);
  }

  public void OnDocumentChanged(object sender, GH_CanvasDocumentChangedEventArgs e){
    using(var args = new Rhino.Runtime.NamedParametersEventArgs()){
      args.Set("id", comp.InstanceGuid.ToString());
      Rhino.Runtime.HostUtils.ExecuteNamedCallback("FromGHClearUI", args);

      forceUpdate = true;

      if(comp != null){
        comp.ExpireSolution(true);
      }
    }
  }
# ---------- end unisli ----------

# ---- group: PlacePt
pt_3 = Point([Point(695.8963448, 123.4176258, 0), Point(545.6555735, 244.4931723, 0)])

# ---- group: Create Tool
# The TCP (Tool Center Point) Plane is defined. The tool geometry is defined for an opened and closed tool. This is meshed, joined and added to the plane.
toolheight_mm = Panel("157")
gripmax_mm = Panel("60")
subtraction = Subtraction(A=gripmax_mm, B=closed_grip_mm)
subtraction_2 = Subtraction(A=toolheight_mm, B=tcpoffset_inwards_mm)
division = Division(A=subtraction, B=2)
panel = Panel("""1
-1""")
Y = UnitY(Factor=1)
multiplication = Multiplication(A=graft(division), B=panel)
neg = Negative(Value=Y)
amp = Amplitude(Vector=neg, Amplitude=multiplication)
mesh = MeshBrep(
    Brep=brep_3,
    Settings={GridMaxCount=0, GridMinCount=16, JaggedSeams=True, MaxEdgeLength=0, MinEdgeLength=2.5, MinTolerance=0, Refine=True, RefineAngle=0.0872664626, RelativeTolerance=0.65, SimplePlanes=True, Tolerance=0})
mesh_2 = MeshBrep(
    Brep=tooldynamicgeo,
    Settings={GridMaxCount=0, GridMinCount=16, JaggedSeams=True, MaxEdgeLength=0, MinEdgeLength=2.5, MinTolerance=0, Refine=True, RefineAngle=0, RelativeTolerance=0.65, SimplePlanes=True, Tolerance=0})
pt_4 = ConstructPoint(XCoordinate=0, YCoordinate=0, ZCoordinate=subtraction_2)
move = Move(Geometry=mesh_2, Motion=amp)  # -> Geometry, Transform
merge_2 = Merge(Data1=move.Geometry, Data2=mesh)  # -> flatten(Result)
merge_3 = Merge(Data1=mesh_2, Data2=mesh)  # -> flatten(Result)
xy = XYPlane(Origin=pt_4)
pl = ConstructPlane(Origin=xy, XAxis=Vector(1, 0, 0), YAxis=Vector(0, 1, 0))
mjoin = MeshJoin(Meshes=merge_2)  # -> flatten(Mesh)
mjoin_2 = MeshJoin(Meshes=merge_3)  # -> flatten(Mesh)
grippername = Panel("""GripperUnloaded
GripperLoaded""")
toolweight_kg = Panel("2.0")
merge_4 = Merge(Data1=mjoin_2, Data2=mjoin)  # -> flatten(Result)
tool = CreateTool(Name=grippername, TCP=pl, Weight=toolweight_kg, Mesh=merge_4)  # -> Tool, TCP

# ---- group: Create Planes
Z = UnitZ(Factor=1)
entwine = Entwine(Branch00=merge, Branch01=pt_3, FlattenInputs=True)
neg_2 = Negative(Value=Z)
pl_2 = PlaneNormal(Origin=entwine, ZAxis=neg_2)
rotate = Rotate(Geometry=pl_2, Angle=degrees([Slider(140, range=0..360), Slider(76, range=0..360)]), Plane=pl_2)  # -> Geometry, Transform
# Speed can be quicker for long Joint movements and should be slower for more accurate Linear movements
approach_z_offset = Slider(200, range=0..1000)
flip = FlipMatrix(Data=rotate.Geometry)
item = ListItem(List=flip, Index=0, Wrap=True)  # -> Item, Item1
Z_2 = UnitZ(Factor=approach_z_offset)
move_2 = Move(Geometry=item.Item, Motion=Z_2)  # -> Geometry, Transform
move_3 = Move(Geometry=item.Item1, Motion=Z_2)  # -> Geometry, Transform
weave = Weave(Pattern=[0, 1, 2], Stream0=move_3.Geometry, Stream1=item.Item1, Stream2=move_3.Geometry, NullGaps=False)
weave_2 = Weave(Pattern=[0, 1, 2], Stream0=move_2.Geometry, Stream1=item.Item, Stream2=move_2.Geometry, NullGaps=False)
merge_5 = Merge(Data1=weave_2, Data2=weave)  # -> flatten(Result)

# ----
lng = ListLength(List=pt_3)
# Every pickup and place point gets assigned an approach frame, which in this case is a Z offset
ptslng = Integer(lng)

# ---- group: Speed
# Connecting the Speed settings to the program will currently cause an error
number_slider = Slider(750, range=0..10000)
# Joint movements are used to efficiently move from A to B in a free space. Linear movements are used when accurately approaching a position.
number_slider_2 = Slider(200, range=0..1000)
speed = SpeedParameter(number_slider)
speed_2 = SpeedParameter(number_slider_2)
entwine_2 = Entwine(
    Branch00=speed,
    Branch01=speed_2,
    Branch02=speed_2,
    Branch03=speed,
    Branch04=speed_2,
    Branch05=speed_2,
    FlattenInputs=True)  # -> flatten(Result)

# ---- group: Movement Type
panel_2 = Panel("""Joint
Linear""")
item_2 = ListItem(List=panel_2, Index=0, Wrap=True)  # -> Item, Item1
entwine_3 = Entwine(
    Branch00=item_2.Item,
    Branch01=item_2.Item1,
    Branch02=item_2.Item1,
    Branch03=item_2.Item,
    Branch04=item_2.Item1,
    Branch05=item_2.Item1,
    FlattenInputs=True)  # -> flatten(Result)

# ---- group: Robot System
list = RobotsLibrary({"TUDelft-LAMA-UR5 (missing)": "TUDelft-LAMA-UR5"}, selected="TUDelft-LAMA-UR5 (missing)", Type=0)
loadrobot = LoadRobotSystem(Name=list, Base=PlaneXY(0, 0, 0))

# ----
item_3 = ListItem(List=tool.Tool, Index=0, Wrap=True)  # -> Item, Item1

# ----
# Connecting the Wait command to the program will currently cause an error
number_slider_3 = Slider(0, range=0..5)
wait = Wait(Time=Slider(0.5, range=0..5))
wait_2 = Wait(Time=number_slider_3)
entwine_4 = Entwine(Branch00=wait_2, Branch01=wait_2, Branch02=wait, Branch03=wait_2, Branch04=wait_2, Branch05=wait, FlattenInputs=True)  # -> flatten(Result)

entwine_5 = Entwine(
    Branch00=item_3.Item,
    Branch01=item_3.Item,
    Branch02=item_3.Item1,
    Branch03=item_3.Item1,
    Branch04=item_3.Item1,
    Branch05=item_3.Item,
    FlattenInputs=True)  # -> flatten(Result)

# ---- group: Home Position
# A home position is added to properly initialize the system and tool
home = Panel("""0
-90
-90
0
90
0""")
gripperunloa = ToolParameter(item_3.Item)
degtorad = DegreesToRadians(Degrees=home, RobotSystem=loadrobot, MechanicalGroup=0)
panel_3 = Panel(gripperunloa)
target = CreateTarget(Joints=degtorad, Tool=gripperunloa, IsCartesian=False)
K = Kinematics(RobotSystem=loadrobot, Target=target, DisplayGeometry=Toggle(False))  # -> Meshes, Joints, Planes, Errors
mesh_3 = Mesh(K.Meshes)

# ---- group: Repeat data for amount of points provided
entwine_6 = Entwine(Branch00=entwine_5, Branch01=entwine_3, FlattenInputs=True)
lng_2 = ListLength(List=entwine_6)
ptslng_2 = Integer(ptslng)
multiplication_2 = Multiplication(A=lng_2, B=ptslng_2)
repeat = RepeatData(Data=entwine_6, Length=multiplication_2)  # -> simplify(Data)
bang = ExplodeTree(Data=repeat)  # -> Branch0, Branch1, Branch2

# ---- group: Create Robot Program
target_2 = CreateTarget(Plane=merge_5, Motion=bang.Branch1, Tool=bang.Branch0, Command=bang.Branch2, IsCartesian=True)
programname = Panel("pickandplace")
ins = InsertItems(List=target_2, Item=target, Indices=0, Wrap=True)
init_2 = Button()
program = CreateProgram(Name=programname, RobotSystem=loadrobot, Targets=ins, StepSize=1)  # -> Program, Code, Duration, Warnings, Errors, JSON
c_script = CSharpScript(init=init_2, json=program.JSON)  # inputs init: Boolean, json: String
# ---------- c_script: C# usings ----------
using Grasshopper.Kernel.Special;
using Grasshopper.GUI.Canvas;
using Grasshopper.Plugin;
# ---------- c_script: C# ----------
    if(json != jsonValue)
    {
      jsonValue = json;
      forceUpdate = true;
    }

    if(forceUpdate || init)
    {
      using(var args = new Rhino.Runtime.NamedParametersEventArgs())
      {
        Component.PingDocument -= OnPingDocument;
        Component.PingDocument += OnPingDocument;
        Component.ObjectChanged -= OnObjectChanged;
        Component.ObjectChanged += OnObjectChanged;
        Grasshopper.Instances.ActiveCanvas.DocumentChanged -= OnDocumentChanged;
        Grasshopper.Instances.ActiveCanvas.DocumentChanged += OnDocumentChanged;

        args.Set("id", Component.InstanceGuid.ToString());
        args.Set("json", jsonValue);

        Rhino.Runtime.HostUtils.ExecuteNamedCallback("FromGHClearUI", args);
        Rhino.Runtime.HostUtils.ExecuteNamedCallback("FromGHData", args);

        Register(Component);
      }

      forceUpdate = false;
    }

    if(json != null)
      jsonValue = json.ToString();
# ---------- c_script: C# additional code ----------
  string jsonValue = "";

  IGH_Component comp = null;

  bool forceUpdate = false;

  void Register(IGH_Component component)
  {
    comp = component;
  }

  public void OnPingDocument(object sender, GH_PingDocumentEventArgs e){
    if(e.Document == null){
      using(var args = new Rhino.Runtime.NamedParametersEventArgs()){
        args.Set("id", comp.InstanceGuid.ToString());
        args.Set("json", jsonValue);
        Rhino.Runtime.HostUtils.ExecuteNamedCallback("FromGHClearUI", args);
        Rhino.Runtime.HostUtils.ExecuteNamedCallback("FromGHData", args);
      }
    }
  }

  public void OnObjectChanged(object sender, GH_ObjectChangedEventArgs e){
    if(e.Type == GH_ObjectEventType.Enabled){
      if(comp.Locked){
        using(var args = new Rhino.Runtime.NamedParametersEventArgs()){
          forceUpdate = true;
          args.Set("id", comp.InstanceGuid.ToString());
          args.Set("json", jsonValue);
          Rhino.Runtime.HostUtils.ExecuteNamedCallback("FromGHClearUI", args);
          Rhino.Runtime.HostUtils.ExecuteNamedCallback("FromGHData", args);
        }
      }
    }

    comp.ExpireSolution(true);
  }

  public void OnDocumentChanged(object sender, GH_CanvasDocumentChangedEventArgs e){
    using(var args = new Rhino.Runtime.NamedParametersEventArgs()){
      args.Set("id", comp.InstanceGuid.ToString());
      args.Set("json", jsonValue);
      Rhino.Runtime.HostUtils.ExecuteNamedCallback("FromGHClearUI", args);
      Rhino.Runtime.HostUtils.ExecuteNamedCallback("FromGHData", args);

      forceUpdate = true;

      if(comp != null){
        comp.ExpireSolution(true);
      }
    }
  }
# ---------- end c_script ----------

# ---- group: Rhino Playback and Preview
sim = ProgramSimulation(Program=program.Program, Time=Slider(0.14, range=0..1), Normalized=True)  # -> SystemMeshes, JointRotations, Plane, Index, Time, Program, Errors
preview = CustomPreview(Geometry=sim.SystemMeshes, Material=ColourSwatch(SwatchColor=RGB(199, 88, 66)))

# ----
targets = Panel(target_2)
warnings = Panel(program.Warnings)
code = Panel(program.Code)
errors = Panel(program.Errors)
