# Grasshopper definition UnityReceiver.gh (Grasshopper 1.0.7)
# plug-ins: Robots

x_position = Slider(0, range=0..100)
init = Button()
init_2 = Button()
pt = Point(Point(578.6177642, -50.88953005, 440.3286886))
height = Slider(0.183, range=0..1)
unityobject = CSharpScript(init=init_2)  # -> Data, Position, Rotation; inputs init: Boolean
# ---------- unityobject: C# usings ----------
using Grasshopper.Kernel.Special;
using Grasshopper.GUI.Canvas;
# ---------- unityobject: C# ----------
    if(forceUpdate || init)
    {
      using(var args = new Rhino.Runtime.NamedParametersEventArgs())
      {
        Component.PingDocument -= OnPingDocument;
        Component.PingDocument += OnPingDocument;
        Component.ObjectChanged -= OnObjectChanged;
        Component.ObjectChanged += OnObjectChanged;
        Grasshopper.Instances.ActiveCanvas.DocumentChanged -= OnDocumentChanged;
        Grasshopper.Instances.ActiveCanvas.DocumentChanged += OnDocumentChanged;

        args.Set("id", Component.InstanceGuid.ToString());
        Rhino.Runtime.HostUtils.ExecuteNamedCallback("FromGHTransform", args);

        Register(Component);
      }

      forceUpdate = false;
    }

    Data = dataValue;
    Position = posValue;
    Rotation = rotValue;
# ---------- unityobject: C# additional code ----------
  string dataValue = "";
  Vector3d posValue;
  Vector3d rotValue;

  IGH_Component comp = null;

  bool forceUpdate = false;

  void Register(IGH_Component component)
  {
    Rhino.Runtime.HostUtils.RegisterNamedCallback("ToGH_Position_" + Component.InstanceGuid.ToString(), ToGrasshopper);
    Rhino.Runtime.HostUtils.RegisterNamedCallback("ToGH_Rotation_" + Component.InstanceGuid.ToString(), ToGrasshopper);

    comp = component;
  }

  void ToGrasshopper(object sender, Rhino.Runtime.NamedParametersEventArgs args)
  {
    Vector3d position;
    Vector3d rotation;

    if (args.TryGetVector("position", out position))
    {
      posValue = new Vector3d(position.X, position.Z, position.Y);
    }
    if (args.TryGetVector("rotation", out rotation))
    {
      rotValue = new Vector3d(rotation.X, rotation.Z, rotation.Y);
    }

    comp.ExpireSolution(true);
  }

  public void OnPingDocument(object sender, GH_PingDocumentEventArgs e){
    if(e.Document == null){
      using(var args = new Rhino.Runtime.NamedParametersEventArgs()){
        args.Set("id", comp.InstanceGuid.ToString());
      }
    }
  }

  public void OnObjectChanged(object sender, GH_ObjectChangedEventArgs e){
    if(e.Type == GH_ObjectEventType.Enabled){
      if(comp.Locked){
        using(var args = new Rhino.Runtime.NamedParametersEventArgs()){
          forceUpdate = true;
          args.Set("id", comp.InstanceGuid.ToString());
        }
      }
    }

    comp.ExpireSolution(true);
  }

  public void OnDocumentChanged(object sender, GH_CanvasDocumentChangedEventArgs e){
    using(var args = new Rhino.Runtime.NamedParametersEventArgs()){
      args.Set("id", comp.InstanceGuid.ToString());

      forceUpdate = true;

      if(comp != null){
        comp.ExpireSolution(true);
      }
    }
  }
# ---------- end unityobject ----------
pt_2 = Point(Point(504.6680807, 0, 233.4831237))
unitytoggle = CSharpScript(toggle=Toggle(False), init=init)  # -> out, Value; inputs toggle: Boolean, init: Boolean
# ---------- unitytoggle: C# ----------
    if(toggle != prevVal){
      prevVal = toggle;
      toggleVal = toggle;
    }

    var inputs = Component.Params.Input;
    var finput = inputs[0];
    if(finput.SourceCount > 0){
      var tglcomp = finput.Sources[0];
      if(tglcomp.GetType() == typeof(GH_BooleanToggle)){
        var tgl = (GH_BooleanToggle) tglcomp;
        bool val = tgl.Value;
        var name = tgl.NickName;

        if(forceUpdate || name != prevName || init){
          using(var args = new Rhino.Runtime.NamedParametersEventArgs()){
            Component.PingDocument -= OnPingDocument;
            Component.PingDocument += OnPingDocument;
            Component.ObjectChanged -= OnObjectChanged;
            Component.ObjectChanged += OnObjectChanged;
            Grasshopper.Instances.ActiveCanvas.DocumentChanged -= OnDocumentChanged;
            Grasshopper.Instances.ActiveCanvas.DocumentChanged += OnDocumentChanged;

            args.Set("id", Component.InstanceGuid.ToString());
            args.Set("name", name);
            args.Set("value", val);
            Rhino.Runtime.HostUtils.ExecuteNamedCallback("FromGHClearUI", args);
            Rhino.Runtime.HostUtils.ExecuteNamedCallback("FromGHCreateToggle", args);

            Register(Component);
          }

          prevName = name;
          forceUpdate = false;
        }
      }
    }


    Value = toggleVal;
# ---------- unitytoggle: C# additional code ----------
  bool toggleVal = false;
  bool prevVal = false;
  IGH_Component comp = null;

  string prevName = "";
  bool forceUpdate = false;

  void Register(IGH_Component component)
  {
    Rhino.Runtime.HostUtils.RegisterNamedCallback("ToGH_Toggle_" + Component.InstanceGuid.ToString(), ToGrasshopper);

    comp = component;
  }

  void ToGrasshopper(object sender, Rhino.Runtime.NamedParametersEventArgs args)
  {
    bool val;
    if (args.TryGetBool("toggleValue", out val)){
      toggleVal = val;

      if(Component.Params.Input[0].SourceCount > 0){
        var c = Component.Params.Input[0].Sources[0];
        if(c.GetType() == typeof(GH_BooleanToggle)){
          var tgl = (GH_BooleanToggle) c;
          tgl.Value = val;
        }
      }
    }

    comp.ExpireSolution(true);
  }

  public void OnPingDocument(object sender, GH_PingDocumentEventArgs e){
    if(e.Document == null){
      using(var args = new Rhino.Runtime.NamedParametersEventArgs()){
        args.Set("id", comp.InstanceGuid.ToString());
        Rhino.Runtime.HostUtils.ExecuteNamedCallback("FromGHClearUI", args);
      }
    }
  }

  public void OnObjectChanged(object sender, GH_ObjectChangedEventArgs e){
    if(e.Type == GH_ObjectEventType.Enabled){
      if(comp.Locked){
        using(var args = new Rhino.Runtime.NamedParametersEventArgs()){
          forceUpdate = true;
          args.Set("id", comp.InstanceGuid.ToString());
          Rhino.Runtime.HostUtils.ExecuteNamedCallback("FromGHClearUI", args);
        }
      }
    }

    comp.ExpireSolution(true);
  }

  public void OnDocumentChanged(object sender, GH_CanvasDocumentChangedEventArgs e){
    using(var args = new Rhino.Runtime.NamedParametersEventArgs()){
      args.Set("id", comp.InstanceGuid.ToString());
      Rhino.Runtime.HostUtils.ExecuteNamedCallback("FromGHClearUI", args);

      forceUpdate = true;

      if(comp != null){
        comp.ExpireSolution(true);
      }
    }
  }
# ---------- end unitytoggle ----------
unityslider = CSharpScript(num=x_position, init=init)  # -> out, Value; inputs num: Double, init: Boolean
# ---------- unityslider: C# ----------
    if(num != prevVal){
      prevVal = num;
      sliderVal = num;
    }

    var inputs = Component.Params.Input;
    var finput = inputs[0];
    if(finput.SourceCount > 0){
      var slicomp = finput.Sources[0];
      if(slicomp.GetType() == typeof(GH_NumberSlider)){
        var slider = (GH_NumberSlider) slicomp;
        double min = Convert.ToDouble(slider.Slider.Minimum);
        double max = Convert.ToDouble(slider.Slider.Maximum);
        double val = Convert.ToDouble(slider.Slider.Value);
        var name = slider.NickName;
        int decim = slider.Slider.DecimalPlaces;
        int type = (int) slider.Slider.Type;

        if(forceUpdate || min != prevMin || max != prevMax || name != prevName || decim != prevDecim || type != prevType || init){
          using(var args = new Rhino.Runtime.NamedParametersEventArgs()){
            Component.PingDocument -= OnPingDocument;
            Component.PingDocument += OnPingDocument;
            Component.ObjectChanged -= OnObjectChanged;
            Component.ObjectChanged += OnObjectChanged;
            Grasshopper.Instances.ActiveCanvas.DocumentChanged -= OnDocumentChanged;
            Grasshopper.Instances.ActiveCanvas.DocumentChanged += OnDocumentChanged;

            args.Set("id", Component.InstanceGuid.ToString());
            args.Set("name", name);
            args.Set("min", min);
            args.Set("max", max);
            args.Set("decimal", decim);
            args.Set("value", val);
            args.Set("type", type);
            Rhino.Runtime.HostUtils.ExecuteNamedCallback("FromGHClearUI", args);
            Rhino.Runtime.HostUtils.ExecuteNamedCallback("FromGHCreateSlider", args);

            Register(Component);
          }

          prevMin = min;
          prevMax = max;
          prevName = name;
          prevDecim = decim;
          prevType = type;
          forceUpdate = false;
        }
      }
    }


    Value = sliderVal;
# ---------- unityslider: C# additional code ----------
  double sliderVal = 0.0;
  double prevVal = 0.0;
  IGH_Component comp = null;

  double prevMin = double.PositiveInfinity;
  double prevMax = double.PositiveInfinity;
  string prevName = "";
  int prevDecim = -1;
  int prevType = -1;
  bool forceUpdate = false;

  void Register(IGH_Component component)
  {
    Rhino.Runtime.HostUtils.RegisterNamedCallback("ToGH_Slider_" + Component.InstanceGuid.ToString(), ToGrasshopper);

    comp = component;
  }

  void ToGrasshopper(object sender, Rhino.Runtime.NamedParametersEventArgs args)
  {
    double val;
    if (args.TryGetDouble("sliderValue", out val)){
      sliderVal = val;

      if(Component.Params.Input[0].SourceCount > 0){
        var c = Component.Params.Input[0].Sources[0];
        if(c.GetType() == typeof(Grasshopper.Kernel.Special.GH_NumberSlider)){
          var slider = (Grasshopper.Kernel.Special.GH_NumberSlider) c;
          slider.SetSliderValue(Convert.ToDecimal(sliderVal));
        }
      }
    }

    comp.ExpireSolution(true);
  }

  public void OnPingDocument(object sender, GH_PingDocumentEventArgs e){
    if(e.Document == null){
      using(var args = new Rhino.Runtime.NamedParametersEventArgs()){
        args.Set("id", comp.InstanceGuid.ToString());
        Rhino.Runtime.HostUtils.ExecuteNamedCallback("FromGHClearUI", args);
      }
    }
  }

  public void OnObjectChanged(object sender, GH_ObjectChangedEventArgs e){
    if(e.Type == GH_ObjectEventType.Enabled){
      if(comp.Locked){
        using(var args = new Rhino.Runtime.NamedParametersEventArgs()){
          forceUpdate = true;
          args.Set("id", comp.InstanceGuid.ToString());
          Rhino.Runtime.HostUtils.ExecuteNamedCallback("FromGHClearUI", args);
        }
      }
    }

    comp.ExpireSolution(true);
  }

  public void OnDocumentChanged(object sender, GH_CanvasDocumentChangedEventArgs e){
    using(var args = new Rhino.Runtime.NamedParametersEventArgs()){
      args.Set("id", comp.InstanceGuid.ToString());
      Rhino.Runtime.HostUtils.ExecuteNamedCallback("FromGHClearUI", args);

      forceUpdate = true;

      if(comp != null){
        comp.ExpireSolution(true);
      }
    }
  }
# ---------- end unityslider ----------
xy = XYPlane(Origin=pt)
xy_2 = XYPlane(Origin=pt_2)
pt2num = PointsToNumbers(Points=unityobject.Position, Mask=4)
pt2num_2 = PointsToNumbers(Points=unityobject.Rotation, Mask=4)
unityslider_2 = UnitySlider(num=height, init=Button())  # -> out, Value; inputs num: Double, init: Boolean; same code as unityslider
pflip = FlipPlane(Plane=xy, ReverseX=False, ReverseY=False, SwapAxes=True)
pflip_2 = FlipPlane(Plane=xy_2, ReverseX=False, ReverseY=False, SwapAxes=True)
rad = Radians(Degrees=pt2num_2)
merge = Merge(Data1=pt2num, Data2=rad)  # -> flatten(Result)
list = RobotsLibrary({"TUDelft-LAMA-UR5 (missing)": "TUDelft-LAMA-UR5"}, selected="TUDelft-LAMA-UR5 (missing)", Type=0)
panel = Panel(merge)
loadrobot = LoadRobotSystem(Name=list, Base=PlaneXY(0, 0, 0))
getplane = GetPlane(Numbers=merge, RobotSystem=loadrobot)
list_2 = FlagFields({"Shoulder": 1, "Elbow": 2, "Wrist": 4}, selected=[])
list_3 = FlagFields({"Shoulder": 1, "Elbow": 2, "Wrist": 4}, selected=[])
getplane_2 = GetPlane(Numbers=merge, RobotSystem=loadrobot)
target = CreateTarget(Plane=getplane_2, RobConf=list_3, IsCartesian=True)
target_2 = CreateTarget(Plane=getplane, RobConf=list_2, IsCartesian=True)
init_3 = Button()
program = CreateProgram(Name="DefaultProgram", RobotSystem=loadrobot, Targets=target_2, StepSize=1)  # -> Program, Code, Duration, Warnings, Errors, JSON
c_script = CSharpScript()  # inputs init: Boolean, N: String, R: String, T: String
# ---------- c_script: C# usings ----------
using Grasshopper.Kernel.Special;
using Grasshopper.GUI.Canvas;
using Grasshopper.Plugin;
# ---------- c_script: C# ----------
    if(forceUpdate || init)
    {
      using(var args = new Rhino.Runtime.NamedParametersEventArgs())
      {
        Component.PingDocument -= OnPingDocument;
        Component.PingDocument += OnPingDocument;
        Component.ObjectChanged -= OnObjectChanged;
        Component.ObjectChanged += OnObjectChanged;
        Grasshopper.Instances.ActiveCanvas.DocumentChanged -= OnDocumentChanged;
        Grasshopper.Instances.ActiveCanvas.DocumentChanged += OnDocumentChanged;

        args.Set("id", Component.InstanceGuid.ToString());
        args.Set("N", nValue);
        args.Set("R", rValue);
        args.Set("T", tValue);
        args.Set("C", cValue);
        args.Set("I", iValue);
        args.Set("S", sValue);
        Rhino.Runtime.HostUtils.ExecuteNamedCallback("FromGHClearUI", args);
        Rhino.Runtime.HostUtils.ExecuteNamedCallback("FromGHData", args);

        Register(Component);
      }

      forceUpdate = false;
    }
    if(N != null)
      nValue = N.ToString();
    if(R != null)
      rValue = R.ToString();
    if(T != null)
      tValue = T.ToString();
    if(C != null)
      cValue = C.ToString();
    if(I != null)
      iValue = I.ToString();
    if(S != null)
      sValue = S.ToString();
# ---------- c_script: C# additional code ----------
  string nValue = "", rValue = "", tValue = "", cValue = "", iValue = "", sValue = "";

  IGH_Component comp = null;

  bool forceUpdate = false;

  void Register(IGH_Component component)
  {
    comp = component;
  }

  public void OnPingDocument(object sender, GH_PingDocumentEventArgs e){
    if(e.Document == null){
      using(var args = new Rhino.Runtime.NamedParametersEventArgs()){
        args.Set("id", comp.InstanceGuid.ToString());
        args.Set("N", nValue);
        args.Set("R", rValue);
        args.Set("T", tValue);
        args.Set("C", cValue);
        args.Set("I", iValue);
        args.Set("S", sValue);
        Rhino.Runtime.HostUtils.ExecuteNamedCallback("FromGHClearUI", args);
      }
    }
  }

  public void OnObjectChanged(object sender, GH_ObjectChangedEventArgs e){
    if(e.Type == GH_ObjectEventType.Enabled){
      if(comp.Locked){
        using(var args = new Rhino.Runtime.NamedParametersEventArgs()){
          forceUpdate = true;
          args.Set("id", comp.InstanceGuid.ToString());
          args.Set("N", nValue);
          args.Set("R", rValue);
          args.Set("T", tValue);
          args.Set("C", cValue);
          args.Set("I", iValue);
          args.Set("S", sValue);
          Rhino.Runtime.HostUtils.ExecuteNamedCallback("FromGHClearUI", args);
        }
      }
    }

    comp.ExpireSolution(true);
  }

  public void OnDocumentChanged(object sender, GH_CanvasDocumentChangedEventArgs e){
    using(var args = new Rhino.Runtime.NamedParametersEventArgs()){
      args.Set("id", comp.InstanceGuid.ToString());
      args.Set("N", nValue);
      args.Set("R", rValue);
      args.Set("T", tValue);
      args.Set("C", cValue);
      args.Set("I", iValue);
      args.Set("S", sValue);
      Rhino.Runtime.HostUtils.ExecuteNamedCallback("FromGHClearUI", args);

      forceUpdate = true;

      if(comp != null){
        comp.ExpireSolution(true);
      }
    }
  }
# ---------- end c_script ----------
c_script_2 = CSharpScript(init=init_3, json=program.JSON)  # inputs init: Boolean, json: String
# ---------- c_script_2: C# ----------
    if(json != jsonValue)
    {
      jsonValue = json;
      forceUpdate = true;
    }

    if(forceUpdate || init)
    {
      using(var args = new Rhino.Runtime.NamedParametersEventArgs())
      {
        Component.PingDocument -= OnPingDocument;
        Component.PingDocument += OnPingDocument;
        Component.ObjectChanged -= OnObjectChanged;
        Component.ObjectChanged += OnObjectChanged;
        Grasshopper.Instances.ActiveCanvas.DocumentChanged -= OnDocumentChanged;
        Grasshopper.Instances.ActiveCanvas.DocumentChanged += OnDocumentChanged;

        args.Set("id", Component.InstanceGuid.ToString());
        args.Set("json", jsonValue);

        Rhino.Runtime.HostUtils.ExecuteNamedCallback("FromGHClearUI", args);
        Rhino.Runtime.HostUtils.ExecuteNamedCallback("FromGHData", args);

        Register(Component);
      }

      forceUpdate = false;
    }

    if(json != null)
      jsonValue = json.ToString();
# ---------- c_script_2: C# additional code ----------
  string jsonValue = "";

  IGH_Component comp = null;

  bool forceUpdate = false;

  void Register(IGH_Component component)
  {
    comp = component;
  }

  public void OnPingDocument(object sender, GH_PingDocumentEventArgs e){
    if(e.Document == null){
      using(var args = new Rhino.Runtime.NamedParametersEventArgs()){
        args.Set("id", comp.InstanceGuid.ToString());
        args.Set("json", jsonValue);
        Rhino.Runtime.HostUtils.ExecuteNamedCallback("FromGHClearUI", args);
        Rhino.Runtime.HostUtils.ExecuteNamedCallback("FromGHData", args);
      }
    }
  }

  public void OnObjectChanged(object sender, GH_ObjectChangedEventArgs e){
    if(e.Type == GH_ObjectEventType.Enabled){
      if(comp.Locked){
        using(var args = new Rhino.Runtime.NamedParametersEventArgs()){
          forceUpdate = true;
          args.Set("id", comp.InstanceGuid.ToString());
          args.Set("json", jsonValue);
          Rhino.Runtime.HostUtils.ExecuteNamedCallback("FromGHClearUI", args);
          Rhino.Runtime.HostUtils.ExecuteNamedCallback("FromGHData", args);
        }
      }
    }

    comp.ExpireSolution(true);
  }

  public void OnDocumentChanged(object sender, GH_CanvasDocumentChangedEventArgs e){
    using(var args = new Rhino.Runtime.NamedParametersEventArgs()){
      args.Set("id", comp.InstanceGuid.ToString());
      args.Set("json", jsonValue);
      Rhino.Runtime.HostUtils.ExecuteNamedCallback("FromGHClearUI", args);
      Rhino.Runtime.HostUtils.ExecuteNamedCallback("FromGHData", args);

      forceUpdate = true;

      if(comp != null){
        comp.ExpireSolution(true);
      }
    }
  }
# ---------- end c_script_2 ----------
panel_2 = Panel(program.Warnings)
panel_3 = Panel(program.Errors)
sim = ProgramSimulation(Program=program.Program, Time=Slider(0, range=0..1), Normalized=True)  # -> SystemMeshes, JointRotations, Plane, Index, Time, Program, Errors
