# Grasshopper definition RhinoInsideUnity.gh (Grasshopper 1.0.7)

box_number = Slider(20, range=0..20)
button = Button()
change_shape = BooleanToggle(False)
angle = Slider(10.26, range=0..30)
size = Slider(2.5, range=0..4)
height = Slider(0.23, range=0..1)
unitytoggle = UnitySlider(toggle=change_shape, init=button)  # -> out, Value; inputs toggle: Boolean, init: Boolean
# ---------- unitytoggle: C# usings ----------
using Grasshopper.Kernel.Special;
using Grasshopper.GUI.Canvas;
# ---------- unitytoggle: C# ----------
    if(toggle != prevVal){
      prevVal = toggle;
      toggleVal = toggle;
    }

    var inputs = Component.Params.Input;
    var finput = inputs[0];
    if(finput.SourceCount > 0){
      var tglcomp = finput.Sources[0];
      if(tglcomp.GetType() == typeof(GH_BooleanToggle)){
        var tgl = (GH_BooleanToggle) tglcomp;
        bool val = tgl.Value;
        var name = tgl.NickName;

        if(forceUpdate || name != prevName || init){
          using(var args = new Rhino.Runtime.NamedParametersEventArgs()){
            Component.PingDocument -= OnPingDocument;
            Component.PingDocument += OnPingDocument;
            Component.ObjectChanged -= OnObjectChanged;
            Component.ObjectChanged += OnObjectChanged;
            Grasshopper.Instances.ActiveCanvas.DocumentChanged -= OnDocumentChanged;
            Grasshopper.Instances.ActiveCanvas.DocumentChanged += OnDocumentChanged;

            args.Set("id", Component.InstanceGuid.ToString());
            args.Set("name", name);
            args.Set("value", val);
            
            Rhino.Runtime.HostUtils.ExecuteNamedCallback("FromGHClearUI", args);
            Rhino.Runtime.HostUtils.ExecuteNamedCallback("FromGHCreateToggle", args);

            Register(Component);
          }

          prevName = name;
          forceUpdate = false;
        }
      }
    }


    Value = toggleVal;
# ---------- unitytoggle: C# additional code ----------
  bool toggleVal = false;
  bool prevVal = false;
  IGH_Component comp = null;

  string prevName = "";
  bool forceUpdate = false;

  void Register(IGH_Component component)
  {
    Rhino.Runtime.HostUtils.RegisterNamedCallback("ToGH_Toggle_" + Component.InstanceGuid.ToString(), ToGrasshopper);

    comp = component;
  }

  void ToGrasshopper(object sender, Rhino.Runtime.NamedParametersEventArgs args)
  {
    bool val;
    if (args.TryGetBool("toggleValue", out val)){
      toggleVal = val;

      if(Component.Params.Input[0].SourceCount > 0){
        var c = Component.Params.Input[0].Sources[0];
        if(c.GetType() == typeof(GH_BooleanToggle)){
          var toggle = (GH_BooleanToggle) c;
          toggle.Value = val;
        }
      }
    }

    comp.ExpireSolution(true);
  }

  public void OnPingDocument(object sender, GH_PingDocumentEventArgs e){
    if(e.Document == null){
      using(var args = new Rhino.Runtime.NamedParametersEventArgs()){
        args.Set("id", comp.InstanceGuid.ToString());
        Rhino.Runtime.HostUtils.ExecuteNamedCallback("FromGHClearUI", args);
      }
    }
  }

  public void OnObjectChanged(object sender, GH_ObjectChangedEventArgs e){
    if(e.Type == GH_ObjectEventType.Enabled){
      if(comp.Locked){
        using(var args = new Rhino.Runtime.NamedParametersEventArgs()){
          forceUpdate = true;
          args.Set("id", comp.InstanceGuid.ToString());
          Rhino.Runtime.HostUtils.ExecuteNamedCallback("FromGHClearUI", args);
        }
      }
    }

    comp.ExpireSolution(true);
  }

  public void OnDocumentChanged(object sender, GH_CanvasDocumentChangedEventArgs e){
    using(var args = new Rhino.Runtime.NamedParametersEventArgs()){
      args.Set("id", comp.InstanceGuid.ToString());
      Rhino.Runtime.HostUtils.ExecuteNamedCallback("FromGHClearUI", args);

      forceUpdate = true;

      if(comp != null){
        comp.ExpireSolution(true);
      }
    }
  }
# ---------- end unitytoggle ----------
unityslider = UnitySlider(num=angle, init=button)  # -> out, Value; inputs num: Double, init: Boolean
# ---------- unityslider: C# ----------
    if(num != prevVal){
      prevVal = num;
      sliderVal = num;
    }

    var inputs = Component.Params.Input;
    var finput = inputs[0];
    if(finput.SourceCount > 0){
      var slicomp = finput.Sources[0];
      if(slicomp.GetType() == typeof(GH_NumberSlider)){
        var slider = (GH_NumberSlider) slicomp;
        double min = Convert.ToDouble(slider.Slider.Minimum);
        double max = Convert.ToDouble(slider.Slider.Maximum);
        double val = Convert.ToDouble(slider.Slider.Value);
        var name = slider.NickName;
        int decim = slider.Slider.DecimalPlaces;
        int type = (int) slider.Slider.Type;

        if(forceUpdate || min != prevMin || max != prevMax || name != prevName || decim != prevDecim || type != prevType || init){
          using(var args = new Rhino.Runtime.NamedParametersEventArgs()){
            Component.PingDocument -= OnPingDocument;
            Component.PingDocument += OnPingDocument;
            Component.ObjectChanged -= OnObjectChanged;
            Component.ObjectChanged += OnObjectChanged;
            Grasshopper.Instances.ActiveCanvas.DocumentChanged -= OnDocumentChanged;
            Grasshopper.Instances.ActiveCanvas.DocumentChanged += OnDocumentChanged;

            args.Set("id", Component.InstanceGuid.ToString());
            args.Set("name", name);
            args.Set("min", min);
            args.Set("max", max);
            args.Set("decimal", decim);
            args.Set("value", val);
            args.Set("type", type);
            Rhino.Runtime.HostUtils.ExecuteNamedCallback("FromGHClearUI", args);
            Rhino.Runtime.HostUtils.ExecuteNamedCallback("FromGHCreateSlider", args);

            Register(Component);
          }

          prevMin = min;
          prevMax = max;
          prevName = name;
          prevDecim = decim;
          prevType = type;
          forceUpdate = false;
        }
      }
    }


    Value = sliderVal;
# ---------- unityslider: C# additional code ----------
  double sliderVal = 0.0;
  double prevVal = 0.0;
  IGH_Component comp = null;

  double prevMin = double.PositiveInfinity;
  double prevMax = double.PositiveInfinity;
  string prevName = "";
  int prevDecim = -1;
  int prevType = -1;
  bool forceUpdate = false;

  void Register(IGH_Component component)
  {
    Rhino.Runtime.HostUtils.RegisterNamedCallback("ToGH_Slider_" + Component.InstanceGuid.ToString(), ToGrasshopper);

    comp = component;
  }

  void ToGrasshopper(object sender, Rhino.Runtime.NamedParametersEventArgs args)
  {
    double val;
    if (args.TryGetDouble("sliderValue", out val)){
      sliderVal = val;

      if(Component.Params.Input[0].SourceCount > 0){
        var c = Component.Params.Input[0].Sources[0];
        if(c.GetType() == typeof(Grasshopper.Kernel.Special.GH_NumberSlider)){
          var slider = (Grasshopper.Kernel.Special.GH_NumberSlider) c;
          slider.SetSliderValue(Convert.ToDecimal(sliderVal));
        }
      }
    }

    comp.ExpireSolution(true);
  }

  public void OnPingDocument(object sender, GH_PingDocumentEventArgs e){
    if(e.Document == null){
      using(var args = new Rhino.Runtime.NamedParametersEventArgs()){
        args.Set("id", comp.InstanceGuid.ToString());
        Rhino.Runtime.HostUtils.ExecuteNamedCallback("FromGHClearUI", args);
      }
    }
  }

  public void OnObjectChanged(object sender, GH_ObjectChangedEventArgs e){
    if(e.Type == GH_ObjectEventType.Enabled){
      if(comp.Locked){
        using(var args = new Rhino.Runtime.NamedParametersEventArgs()){
          forceUpdate = true;
          args.Set("id", comp.InstanceGuid.ToString());
          Rhino.Runtime.HostUtils.ExecuteNamedCallback("FromGHClearUI", args);
        }
      }
    }

    comp.ExpireSolution(true);
  }

  public void OnDocumentChanged(object sender, GH_CanvasDocumentChangedEventArgs e){
    using(var args = new Rhino.Runtime.NamedParametersEventArgs()){
      args.Set("id", comp.InstanceGuid.ToString());
      Rhino.Runtime.HostUtils.ExecuteNamedCallback("FromGHClearUI", args);

      forceUpdate = true;

      if(comp != null){
        comp.ExpireSolution(true);
      }
    }
  }
# ---------- end unityslider ----------
unityslider_2 = UnitySlider(num=size, init=button)  # -> out, Value; inputs num: Double, init: Boolean
# ---------- unityslider_2: C# ----------
    if(num != prevVal){
      prevVal = num;
      sliderVal = num;
    }

    var inputs = Component.Params.Input;
    var finput = inputs[0];
    if(finput.SourceCount > 0){
      var slicomp = finput.Sources[0];
      if(slicomp.GetType() == typeof(GH_NumberSlider)){
        var slider = (GH_NumberSlider) slicomp;
        double min = Convert.ToDouble(slider.Slider.Minimum);
        double max = Convert.ToDouble(slider.Slider.Maximum);
        double val = Convert.ToDouble(slider.Slider.Value);
        var name = slider.NickName;
        int decim = slider.Slider.DecimalPlaces;
        int type = (int) slider.Slider.Type;
        Print(forceUpdate.ToString());

        if(forceUpdate || min != prevMin || max != prevMax || name != prevName || decim != prevDecim || type != prevType || init){
          using(var args = new Rhino.Runtime.NamedParametersEventArgs()){
            Component.PingDocument -= OnPingDocument;
            Component.PingDocument += OnPingDocument;
            Component.ObjectChanged -= OnObjectChanged;
            Component.ObjectChanged += OnObjectChanged;
            Grasshopper.Instances.ActiveCanvas.DocumentChanged -= OnDocumentChanged;
            Grasshopper.Instances.ActiveCanvas.DocumentChanged += OnDocumentChanged;

            args.Set("id", Component.InstanceGuid.ToString());
            args.Set("name", name);
            args.Set("min", min);
            args.Set("max", max);
            args.Set("decimal", decim);
            args.Set("value", val);
            args.Set("type", type);
            Rhino.Runtime.HostUtils.ExecuteNamedCallback("FromGHClearUI", args);
            Rhino.Runtime.HostUtils.ExecuteNamedCallback("FromGHCreateSlider", args);

            Register(Component);
          }

          prevMin = min;
          prevMax = max;
          prevName = name;
          prevDecim = decim;
          prevType = type;
          forceUpdate = false;
        }
      }
    }


    Value = sliderVal;
# ---------- unityslider_2: C# additional code ----------
  double sliderVal = 0.0;
  double prevVal = 0.0;
  IGH_Component comp = null;

  double prevMin = double.PositiveInfinity;
  double prevMax = double.PositiveInfinity;
  string prevName = "";
  int prevDecim = -1;
  int prevType = -1;
  bool forceUpdate = false;

  void Register(IGH_Component component)
  {
    Rhino.Runtime.HostUtils.RegisterNamedCallback("ToGH_Slider_" + Component.InstanceGuid.ToString(), ToGrasshopper);

    comp = component;
  }

  void ToGrasshopper(object sender, Rhino.Runtime.NamedParametersEventArgs args)
  {
    double val;
    if (args.TryGetDouble("sliderValue", out val)){
      sliderVal = val;

      if(Component.Params.Input[0].SourceCount > 0){
        var c = Component.Params.Input[0].Sources[0];
        if(c.GetType() == typeof(Grasshopper.Kernel.Special.GH_NumberSlider)){
          var slider = (Grasshopper.Kernel.Special.GH_NumberSlider) c;
          slider.SetSliderValue(Convert.ToDecimal(sliderVal));
        }
      }
    }

    comp.ExpireSolution(true);
  }

  public void OnPingDocument(object sender, GH_PingDocumentEventArgs e){
    if(e.Document == null){
      using(var args = new Rhino.Runtime.NamedParametersEventArgs()){
        args.Set("id", comp.InstanceGuid.ToString());
        Rhino.Runtime.HostUtils.ExecuteNamedCallback("FromGHClearUI", args);
      }
    }
  }

  public void OnObjectChanged(object sender, GH_ObjectChangedEventArgs e){
    if(e.Type == GH_ObjectEventType.Enabled){
      if(comp.Locked){
        using(var args = new Rhino.Runtime.NamedParametersEventArgs()){
          forceUpdate = true;
          args.Set("id", comp.InstanceGuid.ToString());
          Rhino.Runtime.HostUtils.ExecuteNamedCallback("FromGHClearUI", args);
        }
      }
    }

    comp.ExpireSolution(true);
  }

  public void OnDocumentChanged(object sender, GH_CanvasDocumentChangedEventArgs e){
    using(var args = new Rhino.Runtime.NamedParametersEventArgs()){
      args.Set("id", comp.InstanceGuid.ToString());
      Rhino.Runtime.HostUtils.ExecuteNamedCallback("FromGHClearUI", args);

      forceUpdate = true;

      if(comp != null){
        comp.ExpireSolution(true);
      }
    }
  }
# ---------- end unityslider_2 ----------
unityslider_3 = UnitySlider(num=height, init=button)  # -> out, Value; inputs num: Double, init: Boolean; same code as unityslider
unityslider_4 = UnitySlider(num=box_number, init=button)  # -> out, Value; inputs num: Double, init: Boolean; same code as unityslider
rad = Radians(Degrees=unityslider.Value)
multiplication = Multiplication(A=unityslider_3.Value, B=2)
polygon = Polygon(Plane=PlaneXY(0, 0, 0), Radius=unityslider_2.Value, Segments=6, FilletRadius=0)  # -> Polygon, Length
series = Series(Start=0, Step=rad, Count=unityslider_4.Value)
series_2 = Series(Start=0, Step=multiplication, Count=unityslider_4.Value)
boundary = BoundarySurfaces(Edges=polygon.Polygon)
Z = UnitZ(Factor=multiplication)
bnd = Bounds(Numbers=series)
extr = Extrude(Base=boundary, Direction=Z)
Z_2 = UnitZ(Factor=series_2)
box = CenterBox(Base=PlaneXY(0, 0, 0), X=unityslider_2.Value, Y=unityslider_2.Value, Z=unityslider_3.Value)
remap = RemapNumbers(Value=series, Source=bnd, Target=Domain(0, 1))  # -> Mapped, Clipped
filter = StreamFilter(Gate=unitytoggle.Value, Stream0=box, Stream1=extr)
gradient = Gradient(
    LowerLimit=0,
    UpperLimit=1,
    Parameter=remap.Mapped,
    stops=[0: RGB(234, 38, 0), 0.25: RGB(234, 126, 0), 0.5: RGB(254, 244, 84), 0.75: RGB(173, 203, 249), 1: RGB(75, 107, 169)])
move = Move(Geometry=filter, Motion=Z_2)  # -> Geometry, Transform
rotate = Rotate(Geometry=move.Geometry, Angle=series, Plane=PlaneXY(0, 0, 0))  # -> flatten(Geometry), Transform
unitymesh = UnityMesh(meshes=simplify(rotate.Geometry), mats=simplify(gradient))  # -> outMesh, outMat; inputs meshes: tree of Mesh, mats: tree
# ---------- unitymesh: C# usings ----------
using System.Linq;
using System.Drawing;
using Grasshopper.GUI.Canvas;
# ---------- unitymesh: C# ----------
    if(comp == null){
      Component.PingDocument -= OnPingDocument;
      Component.PingDocument += OnPingDocument;
      Component.ObjectChanged -= OnObjectChanged;
      Component.ObjectChanged += OnObjectChanged;
      Grasshopper.Instances.ActiveCanvas.DocumentChanged -= OnDocumentChanged;
      Grasshopper.Instances.ActiveCanvas.DocumentChanged += OnDocumentChanged;

      comp = Component;
    }
    prevMeshes = meshes;

    DataTree<GH_Material> ghMats = new DataTree<GH_Material>();
    ClearAllMeshes(meshes);

    List <int> tempDataTreeCounts = new List<int>();
    for(int i = 0; i < meshes.BranchCount; i++){
      GH_Path path = meshes.Paths[i];
      tempDataTreeCounts.Add(meshes.Branches[i].Count);

      List<object> matList = mats.Branches[Math.Min(i, mats.BranchCount - 1)];
      for(int n = 0; n < meshes.Branches[i].Count; n++){
        Mesh mesh = meshes.Branches[i][n];
        object mat = matList[Math.Min(n, matList.Count - 1)];
        using(var args = new Rhino.Runtime.NamedParametersEventArgs())
        {
          Color color = Color.White;
          Color emission = Color.Black;
          Color specular = Color.DarkGray;
          double transparency = 0f;
          double shine = 50;


          if(mat != null && mat.GetType() == typeof(Rhino.Display.DisplayMaterial)){
            var material = (Rhino.Display.DisplayMaterial) mat;
            color = material.Diffuse;
            emission = material.Emission;
            transparency = material.Transparency;
            shine = material.Shine;
            specular = material.Specular;
          }else if(mat != null && mat.GetType() == typeof(System.Drawing.Color)){
            color = (System.Drawing.Color) mat;
            shine = 0.5;
          }

          args.Set("id", Component.InstanceGuid.ToString() + "-" + i.ToString() + "_" + n.ToString());
          args.Set("mesh", new Mesh[]{mesh});
          args.Set("diffuse", color);
          args.Set("emission", emission);
          args.Set("specular", specular);
          args.Set("transparency", transparency);
          args.Set("shine", shine);
          Rhino.Runtime.HostUtils.ExecuteNamedCallback("FromGHMesh", args);

          var displayMat = new Rhino.Display.DisplayMaterial(color);
          displayMat.Specular = specular;
          displayMat.Emission = emission;
          displayMat.Transparency = transparency;
          displayMat.Shine = shine;

          var ghmat = new GH_Material(displayMat);
          ghMats.Add(ghmat, path);
        }
      }
    }

    prevDataTreeCounts = tempDataTreeCounts;

    outMesh = meshes;
    outMat = ghMats;
# ---------- unitymesh: C# additional code ----------
  IGH_Component comp = null;
  DataTree<Mesh> prevMeshes = new DataTree<Mesh>();
  List<int> prevDataTreeCounts = new List<int>();

  public void OnPingDocument(object sender, GH_PingDocumentEventArgs e){
    if(e.Document == null){
      ClearAllMeshes(prevMeshes);
    }
  }

  public void OnObjectChanged(object sender, GH_ObjectChangedEventArgs e){
    if(e.Type == GH_ObjectEventType.Enabled){
      if(comp.Locked){
        ClearAllMeshes(prevMeshes);
      }
    }

    comp.ExpireSolution(true);
  }

  public void OnDocumentChanged(object sender, GH_CanvasDocumentChangedEventArgs e){
    ClearAllMeshes(prevMeshes);
    if(comp != null){
      comp.ExpireSolution(true);
    }
  }

  public void ClearAllMeshes(DataTree<Mesh> meshes){
    int branchCount = Math.Max(meshes.BranchCount, prevDataTreeCounts.Count);
    for(int i = 0; i < branchCount; i++){
      int meshCount = 0;
      int prevCount = 0;
      if(meshes.BranchCount > i){
        meshCount = meshes.Branches[i].Count;
      }
      if(prevDataTreeCounts.Count > i){
        prevCount = prevDataTreeCounts[i];
      }
      int itemCount = Math.Max(meshCount, prevCount);


      for(int n = 0; n < itemCount; n++){
        using(var args = new Rhino.Runtime.NamedParametersEventArgs()){
          args.Set("id", comp.InstanceGuid.ToString() + "-" + i.ToString() + "_" + n.ToString());
          Rhino.Runtime.HostUtils.ExecuteNamedCallback("FromGHClearMesh", args);
        }
      }
    }
  }
# ---------- end unitymesh ----------
