# Grasshopper definition UnityReceiver.gh (Grasshopper 1.0.7)
# plug-ins: Robots

init = Button()
pt = Point(Point(180, 0, 0))
pt_2 = Point(Point(301.8590428, -50.88953005, 596.6675162))
c_script = CSharpScript(init=init)  # -> Data, Position, Rotation; inputs init: Boolean
# ---------- c_script: C# usings ----------
using Grasshopper.Kernel.Special;
using Grasshopper.GUI.Canvas;
# ---------- c_script: C# ----------
    if(forceUpdate || init)
    {
      using(var args = new Rhino.Runtime.NamedParametersEventArgs())
      {
        Component.PingDocument -= OnPingDocument;
        Component.PingDocument += OnPingDocument;
        Component.ObjectChanged -= OnObjectChanged;
        Component.ObjectChanged += OnObjectChanged;
        Grasshopper.Instances.ActiveCanvas.DocumentChanged -= OnDocumentChanged;
        Grasshopper.Instances.ActiveCanvas.DocumentChanged += OnDocumentChanged;

        args.Set("id", Component.InstanceGuid.ToString());
        args.Set("data", dataValue);
        Rhino.Runtime.HostUtils.ExecuteNamedCallback("FromGHClearUI", args);
        Rhino.Runtime.HostUtils.ExecuteNamedCallback("FromGHData", args);

        Register(Component);
      }

      forceUpdate = false;
    }

    Data = dataValue;
    Position = posValue;
    Rotation = rotValue;
# ---------- c_script: C# additional code ----------
  string dataValue = "";
  Vector3d posValue;
  Vector3d rotValue;

  IGH_Component comp = null;

  bool forceUpdate = false;

  void Register(IGH_Component component)
  {
    Rhino.Runtime.HostUtils.RegisterNamedCallback("ToGH_Data_" + Component.InstanceGuid.ToString(), ToGrasshopper);
    Rhino.Runtime.HostUtils.RegisterNamedCallback("ToGH_Position_" + Component.InstanceGuid.ToString(), ToGrasshopper);
    Rhino.Runtime.HostUtils.RegisterNamedCallback("ToGH_Rotation_" + Component.InstanceGuid.ToString(), ToGrasshopper);

    comp = component;
  }

  void ToGrasshopper(object sender, Rhino.Runtime.NamedParametersEventArgs args)
  {
    string data;
    Vector3d position;
    Vector3d rotation;

    if (args.TryGetString("data", out data))
    {
      dataValue = data;
    }
    if (args.TryGetVector("position", out position))
    {
      posValue = new Vector3d(position.X, position.Z, position.Y);
    }
    if (args.TryGetVector("rotation", out rotation))
    {
      rotValue = new Vector3d(rotation.X, rotation.Z, rotation.Y);
    }

    comp.ExpireSolution(true);
  }

  public void OnPingDocument(object sender, GH_PingDocumentEventArgs e){
    if(e.Document == null){
      using(var args = new Rhino.Runtime.NamedParametersEventArgs()){
        args.Set("id", comp.InstanceGuid.ToString());
        Rhino.Runtime.HostUtils.ExecuteNamedCallback("FromGHClearUI", args);
      }
    }
  }

  public void OnObjectChanged(object sender, GH_ObjectChangedEventArgs e){
    if(e.Type == GH_ObjectEventType.Enabled){
      if(comp.Locked){
        using(var args = new Rhino.Runtime.NamedParametersEventArgs()){
          forceUpdate = true;
          args.Set("id", comp.InstanceGuid.ToString());
          Rhino.Runtime.HostUtils.ExecuteNamedCallback("FromGHClearUI", args);
        }
      }
    }

    comp.ExpireSolution(true);
  }

  public void OnDocumentChanged(object sender, GH_CanvasDocumentChangedEventArgs e){
    using(var args = new Rhino.Runtime.NamedParametersEventArgs()){
      args.Set("id", comp.InstanceGuid.ToString());
      Rhino.Runtime.HostUtils.ExecuteNamedCallback("FromGHClearUI", args);

      forceUpdate = true;

      if(comp != null){
        comp.ExpireSolution(true);
      }
    }
  }
# ---------- end c_script ----------
panel = Panel(pt_2)
panel_2 = Panel(pt)
pt2num = PointsToNumbers(Points=pt_2, Mask=4)
pt2num_2 = PointsToNumbers(Points=pt, Mask=4)
rad = Radians(Degrees=pt2num_2)
list = RobotsLibrary(
    {"Bartlett-IRB120", "Bartlett-IRB1600", "Bartlett-KR6", "Bartlett-KR60-A", "Bartlett-KR60-B", "Bartlett-KR500", "Bartlett-KR60 on track", "Bartlett-UR10", "Bartlett-KR60", "Bartlett-TX200", "Bartlett-TX200L", "Bartlett-RX160", "Bartlett-RX160L", "TUDelft-LAMA-UR5"}, selected="TUDelft-LAMA-UR5",
    Type=0)
panel_3 = Panel(pt2num)
panel_4 = Panel(rad)
merge = Merge(Data1=pt2num, Data2=rad)
loadrobot = LoadRobotSystem(Name=list, Base=PlaneXY(0, 0, 0))
panel_5 = Panel(merge)
getplane = GetPlane(Numbers=merge, RobotSystem=loadrobot)
list_2 = FlagFields({"Shoulder": 1, "Elbow": 2, "Wrist": 4}, selected=[])
target = CreateTarget(Plane=getplane, RobConf=list_2, IsCartesian=True)
init_2 = Button()
program = CreateProgram(Name="DefaultProgram", RobotSystem=loadrobot, Targets=target, StepSize=1)  # -> Program, Code, Duration, Warnings, Errors, JSON
c_script_2 = CSharpScript()  # inputs init: Boolean, N: String, R: String, T: String
# ---------- c_script_2: C# usings ----------
using Grasshopper.Kernel.Special;
using Grasshopper.GUI.Canvas;
using Grasshopper.Plugin;
# ---------- c_script_2: C# ----------
    if(forceUpdate || init)
    {
      using(var args = new Rhino.Runtime.NamedParametersEventArgs())
      {
        Component.PingDocument -= OnPingDocument;
        Component.PingDocument += OnPingDocument;
        Component.ObjectChanged -= OnObjectChanged;
        Component.ObjectChanged += OnObjectChanged;
        Grasshopper.Instances.ActiveCanvas.DocumentChanged -= OnDocumentChanged;
        Grasshopper.Instances.ActiveCanvas.DocumentChanged += OnDocumentChanged;

        args.Set("id", Component.InstanceGuid.ToString());
        args.Set("N", nValue);
        args.Set("R", rValue);
        args.Set("T", tValue);
        args.Set("C", cValue);
        args.Set("I", iValue);
        args.Set("S", sValue);
        Rhino.Runtime.HostUtils.ExecuteNamedCallback("FromGHClearUI", args);
        Rhino.Runtime.HostUtils.ExecuteNamedCallback("FromGHData", args);

        Register(Component);
      }

      forceUpdate = false;
    }
    if(N != null)
      nValue = N.ToString();
    if(R != null)
      rValue = R.ToString();
    if(T != null)
      tValue = T.ToString();
    if(C != null)
      cValue = C.ToString();
    if(I != null)
      iValue = I.ToString();
    if(S != null)
      sValue = S.ToString();
# ---------- c_script_2: C# additional code ----------
  string nValue = "", rValue = "", tValue = "", cValue = "", iValue = "", sValue = "";

  IGH_Component comp = null;

  bool forceUpdate = false;

  void Register(IGH_Component component)
  {
    comp = component;
  }

  public void OnPingDocument(object sender, GH_PingDocumentEventArgs e){
    if(e.Document == null){
      using(var args = new Rhino.Runtime.NamedParametersEventArgs()){
        args.Set("id", comp.InstanceGuid.ToString());
        args.Set("N", nValue);
        args.Set("R", rValue);
        args.Set("T", tValue);
        args.Set("C", cValue);
        args.Set("I", iValue);
        args.Set("S", sValue);
        Rhino.Runtime.HostUtils.ExecuteNamedCallback("FromGHClearUI", args);
      }
    }
  }

  public void OnObjectChanged(object sender, GH_ObjectChangedEventArgs e){
    if(e.Type == GH_ObjectEventType.Enabled){
      if(comp.Locked){
        using(var args = new Rhino.Runtime.NamedParametersEventArgs()){
          forceUpdate = true;
          args.Set("id", comp.InstanceGuid.ToString());
          args.Set("N", nValue);
          args.Set("R", rValue);
          args.Set("T", tValue);
          args.Set("C", cValue);
          args.Set("I", iValue);
          args.Set("S", sValue);
          Rhino.Runtime.HostUtils.ExecuteNamedCallback("FromGHClearUI", args);
        }
      }
    }

    comp.ExpireSolution(true);
  }

  public void OnDocumentChanged(object sender, GH_CanvasDocumentChangedEventArgs e){
    using(var args = new Rhino.Runtime.NamedParametersEventArgs()){
      args.Set("id", comp.InstanceGuid.ToString());
      args.Set("N", nValue);
      args.Set("R", rValue);
      args.Set("T", tValue);
      args.Set("C", cValue);
      args.Set("I", iValue);
      args.Set("S", sValue);
      Rhino.Runtime.HostUtils.ExecuteNamedCallback("FromGHClearUI", args);

      forceUpdate = true;

      if(comp != null){
        comp.ExpireSolution(true);
      }
    }
  }
# ---------- end c_script_2 ----------
c_script_3 = CSharpScript(init=init_2, json=program.JSON)  # inputs init: Boolean, json: String
# ---------- c_script_3: C# ----------
    if(forceUpdate || init)
    {
      using(var args = new Rhino.Runtime.NamedParametersEventArgs())
      {
        Component.PingDocument -= OnPingDocument;
        Component.PingDocument += OnPingDocument;
        Component.ObjectChanged -= OnObjectChanged;
        Component.ObjectChanged += OnObjectChanged;
        Grasshopper.Instances.ActiveCanvas.DocumentChanged -= OnDocumentChanged;
        Grasshopper.Instances.ActiveCanvas.DocumentChanged += OnDocumentChanged;

        args.Set("id", Component.InstanceGuid.ToString());
        args.Set("json", jsonValue);

        Rhino.Runtime.HostUtils.ExecuteNamedCallback("FromGHClearUI", args);
        Rhino.Runtime.HostUtils.ExecuteNamedCallback("FromGHData", args);

        Register(Component);
      }

      forceUpdate = false;
    }
    if(json != null)
      jsonValue = json.ToString();
# ---------- c_script_3: C# additional code ----------
  string jsonValue = "";

  IGH_Component comp = null;

  bool forceUpdate = false;

  void Register(IGH_Component component)
  {
    comp = component;
  }

  public void OnPingDocument(object sender, GH_PingDocumentEventArgs e){
    if(e.Document == null){
      using(var args = new Rhino.Runtime.NamedParametersEventArgs()){
        args.Set("id", comp.InstanceGuid.ToString());
        args.Set("json", jsonValue);
        Rhino.Runtime.HostUtils.ExecuteNamedCallback("FromGHClearUI", args);
      }
    }
  }

  public void OnObjectChanged(object sender, GH_ObjectChangedEventArgs e){
    if(e.Type == GH_ObjectEventType.Enabled){
      if(comp.Locked){
        using(var args = new Rhino.Runtime.NamedParametersEventArgs()){
          forceUpdate = true;
          args.Set("id", comp.InstanceGuid.ToString());
          args.Set("json", jsonValue);
          Rhino.Runtime.HostUtils.ExecuteNamedCallback("FromGHClearUI", args);
        }
      }
    }

    comp.ExpireSolution(true);
  }

  public void OnDocumentChanged(object sender, GH_CanvasDocumentChangedEventArgs e){
    using(var args = new Rhino.Runtime.NamedParametersEventArgs()){
      args.Set("id", comp.InstanceGuid.ToString());
      args.Set("json", jsonValue);
      Rhino.Runtime.HostUtils.ExecuteNamedCallback("FromGHClearUI", args);

      forceUpdate = true;

      if(comp != null){
        comp.ExpireSolution(true);
      }
    }
  }
# ---------- end c_script_3 ----------
panel_6 = Panel(program.Warnings)
panel_7 = Panel(program.Errors)
sim = ProgramSimulation(Program=program.Program, Time=Slider(0, range=0..1), Normalized=True)  # -> SystemMeshes, JointRotations, Plane, Index, Time, Program, Errors
